# Grasshopper definition VoronoiCone.gh (Grasshopper 1.0.7)
# plug-ins: Kangaroo2 Components, LunchBox

length = Slider(5, range=0..5)
radius = Slider(1.748, range=0..5)
md_slider = MDSlider(
    SliderMode=0,
    slider_value=Point(0.7479675107, 0.7195121951, 0.5),
    x_domain=Domain(0, 1),
    y_domain=Domain(0, 1),
    z_domain=Domain(0, 1))
density = Slider(15.855, range=0..25)
u_divisions = Slider(10, range=0..10)
v_divisions = Slider(10, range=0..10)
triangle_panels_b = TrianglePanelsB(UDivisions=u_divisions, VDivisions=v_divisions)
mesh_from_subd = MeshFromSubD(SubD=triangle_panels_b, Density=density)
direction = Direction(Direction=md_slider, Strength=1)
extrude = Extrude(Base=mesh_from_subd, Direction=direction)
voronoi_3d = Voronoi3D(Box=extrude)  # -> Cells, Boundary
brep = Brep(voronoi_3d.Boundary)
point = Point(brep)
cone = Cone(Base=point, Radius=radius, Length=length)  # -> Cone, Tip
surface = Surface(cone.Cone)
geometry = Geometry(surface)
vector = Vector(geometry)
point_2 = Point(vector)
