# Grasshopper definition VoronoiConeForReal.gh (Grasshopper 1.0.7)

length = Slider(12.38, range=0..25)
radius = Slider(5.394, range=0..15)
count = Slider(30.114, range=0..100)
cone = Cone(Base=PlaneXY(0, 0, 0), Radius=radius, Length=length)  # -> Cone, Tip
populate_geometry = PopulateGeometry(Geometry=cone.Cone, Count=count, Seed=1)
bounding_box = BoundingBox(Content=cone.Cone, Plane=PlaneXY(0, 0, 0))  # -> Box, Box_2
voronoi_3d = Voronoi3D(Points=populate_geometry, Box=bounding_box.Box)  # -> Cells, Boundary
brep_brep = BrepBrep(BrepA=cone.Cone, BrepB=voronoi_3d.Cells)  # -> Curves, Points
