# Grasshopper definition pulley.gh (Grasshopper 1.0.7)

radius = Slider(2.54, range=0..6)
length = Slider(1.6, range=0..3)
V = Slider(5.25, range=0..10)
U = Slider(5.25, range=0..10)
cylinder = Cylinder(Base=PlaneXY(0, 0, 0), Radius=radius, Length=length)
brep_join = BrepJoin()  # -> Breps, Closed
mesh_surface = MeshSurface(Surface=cylinder, UCount=U, VCount=V, Overhang=True, Equalize=brep_join.Breps)
quadrangulate = Quadrangulate(Mesh=mesh_surface, Angle=0.03490658504, Ratio=0.875)  # -> Mesh, Count
